# Grasshopper definition Sumer_AIA_GeoOpt_Assignment02_setup_SM_vs_bonus.gh (Grasshopper 1.0.7)
# plug-ins: Weaverbird

number_slider = Slider(20, range=1..20)
number_slider_2 = Slider(10, range=1..20)
python = GhPythonScript(x=Slider(10, range=1..20), y=Slider(10, range=1..20), U=number_slider, V=number_slider_2)  # -> out, a, c, d, e, f, g, h; inputs x: Int32, U: Int32, V: Int32
# ---------- python: Python ----------
import Rhino.Geometry as rg
import ghpythonlib.treehelpers as th
import math
import ghpythonlib.components as ghc

#this is how you initialize a list in python
pointList1 = []
pointList2 = []
for i in range(x):
    pt1 = rg.Point3d(i, 0, 0)
    pt2 = rg.Point3d(i, y, 0)
    pointList1.append(pt1)
    pointList2.append(pt2)

a = pointList1

lineList = []
for i in range(len(pointList1)):
    line = rg.Line(pointList1[i], pointList2[i])
    lineList.append(line)
c = lineList


allDivPts = []
for l in lineList:
    divPts = [] #my list of division points
    nc = l.ToNurbsCurve()
    params = nc.DivideByCount(V, True)
    for p in params:
        divPt = nc.PointAt(p)
        
        vec= rg.Vector3d(divPt)
        vecLen = vec.Length
        mag = math.sin(vecLen)
        transVec = -rg.Vector3d.ZAxis * mag
        
        newPt = divPt - transVec
        divPts.append(newPt)

    allDivPts.append(divPts)

d = th.list_to_tree(allDivPts)


#make a curve from list of points
curveList = []
for i in range(len(allDivPts)):
    curve = rg.Curve.CreateInterpolatedCurve(allDivPts[i], 3)
    curveList.append(curve)
e= curveList


#create a loft surface from curves
surface = rg.Brep.CreateFromLoft(curveList, rg.Point3d.Unset, rg.Point3d.Unset, rg.LoftType.Normal, False)
surface = surface[0].Faces[0]

f = surface

#reparametrize surface
surface.SetDomain(0,rg.Interval(0,U))
surface.SetDomain(1,rg.Interval(0,V))

#get points
allSrfPts=[]
for i in range(U+1):
    srfPts= []
    for j in range(V+1):
        pt=rg.Surface.PointAt(surface,i,j)
        srfPts.append(pt)
    allSrfPts.append(srfPts)
h = allSrfPts


mesh = rg.Mesh()
for i in range(len(allSrfPts)-1):
    for j in range(len(allSrfPts[i])-1):
        m = rg.Mesh()
        v1 = allSrfPts[i][j]
        v2 = allSrfPts[i][j+1]        
        v3 = allSrfPts[i+1][j+1]        
        v4 = allSrfPts[i+1][j]
        
        m.Vertices.Add(v1)
        m.Vertices.Add(v2)
        m.Vertices.Add(v3)
        m.Vertices.Add(v4)
        
        m.Faces.AddFace(0,1,2,3)
        
        mesh.Append(m)

g = mesh

cleanmesh = mesh
#methods to clean a mesh
cleanmesh.Normals.ComputeNormals()
cleanmesh.Vertices.CombineIdentical(True, True)
cleanmesh.Vertices.CullUnused()
cleanmesh.Weld(3.14159265358979)
cleanmesh.UnifyNormals()
cleanmesh.FaceNormals.ComputeFaceNormals()
cleanmesh.Compact()


h = cleanmesh
# ---------- end python ----------

# ---- group: create sun Vector
python_2 = GhPythonScript(
    x=Slider(0.1, range=0..1),
    y=Slider(0.5, range=0..1),
    month=Slider(1, range=1..12),
    day=Slider(1, range=1..31),
    hour=Slider(0, range=0..12),
    minute=Slider(0, range=0..60))  # -> out, a, b, c; inputs month: Int32, minute: Int32
# ---------- python_2: Python ----------
import Rhino.Geometry as rg
import math
import Rhino.Render.Sun as sun
import ghpythonlib.components as ghp
import Rhino

#create a sun vector
#off = (location.split("\n"))[4]
#offset = off.split(",")[0]
#offset = int(math.ceil(float(offset)))

date = ghp.ConstructDate(2021, month, day, hour, minute, 0)
mySun = Rhino.Render.Sun()
Rhino.Render.Sun.SetPosition(mySun, date, x*math.pi, y*math.pi)

#Altitude = mySun.Altitude
#Azimuth = mySun.Azimuth

sVec = Rhino.RhinoDoc.ActiveDoc.Lights.Sun.Vector
sunobj=Rhino.RhinoDoc.ActiveDoc.Lights.Sun

#Rhino.RhinoDoc.ActiveDoc.Lights.Sun in a variable and change the latitude and longitude properties of that object
#sun.Enabled.SetValue(sunPosition,True)
#sun.TimeZone.SetValue(sunPosition, offset)
sunvector=mySun.Vector

#1. create a Sphere at point (0,0,0) with radius 1 and output it to a
#output the sphere to a

point = rg.Point3d(0,0,0)
a = rg.Sphere(point, 1)
#a = sphere

#a = rg.Sphere.ToNurbsSurface(a)
#rg.Surface.SetDomain(a, 0, rg.Interval(0,1))

#2. evaluate a point in the sphere using rg.Sphere.PointAt() at coordintes x and y
#the point should only be on the upper half of the sphere (upper hemisphere)
#the angles are in radians, so you might want to use math.pi for this
#output the point to b

#point = rg.Surface.PointAt(a, x, y)
#point=rg.Sphere.PointAt(a, (x*(22/7)/180), (y*(22/7)/180))
point=rg.Sphere.PointAt(a, (x*math.pi), (y*math.pi))
b = point

#create a vector from the origin  and reverse the vector
#keep in mind that Reverse affects the original vector
#output the vector to c

vec = rg.Vector3d(point)
rg.Vector3d.Reverse(vec)
c = vec
# ---------- end python_2 ----------

# ----
data = Data(python_2.a)
number_slider_3 = Slider(1, range=0..1)
vdis = VectorDisplay(Anchor=python_2.b, Vector=python_2.c)

# ---- group: your .py file goes here
# Assignment 2
path = FilePath("G:\My Drive\AIA Geo Opt\A02\a02_SM.py")

# ---- group: replaceable mesh
mesh = Data(python.h)

# ----
file = ReadFile(File=path, PerLineParse=False)
python_3 = GhPythonScript(
    m=mesh,
    s=python_2.c,
    vec_length=number_slider_3,
    U=number_slider,
    V=number_slider_2,
    min_off=Slider(0.06, range=0..0.5),
    max_off=Slider(0.12, range=0..1),
    height=Slider(0.07, range=0..0.1),
    width=Slider(0.12, range=0..0.2))  # -> out, a, b, c, d, joined_outlines, offset_outlines, lofted_breps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; inputs m: Mesh, s: Vector3d, U: Int32, V: Int32
# ---------- python_3: Python ----------
"""Provides a scripting component.
    Inputs:
        m: a mesh
        s: sun vector
    Output:
        a: List of Vectors
        b: List of Points
        c: list of angles
        d: exploded mesh
        """

#mesh needed to be flipped for correct vector direction

m.Flip(m,True,True)

import Rhino.Geometry as rg
import ghpythonlib.treehelpers as th
import math
import rhinoscriptsyntax as rs
import Rhino.Geometry.Collections as rgc


#1.
#compute face normals using rg.Mesh.FaceNormals.ComputeFaceNormals()
#output the vectors to a

m.FaceNormals.ComputeFaceNormals()

a = m.FaceNormals

#2.
#get the centers of each faces using rg.Mesh.Faces.GetFaceCenter()
#store the centers into a list called centers 
#output that list to b

centers = []
for i in range(len(m.Faces)):
    center = m.Faces.GetFaceCenter(i)
    centers.append(center)

b = centers

#3.
#calculate the angle between the sun and each FaceNormal using rg.Vector3d.VectorAngle()
#store the angles in a list called angleList and output it to c

angleList=[]
for j in a:
    angle = rg.Vector3d.VectorAngle(j, s)
    angleList.append(angle)

c = angleList

#4. explode the mesh - convert each face of the mesh into a mesh
#for this, you have to first copy the mesh using rg.Mesh.Duplicate()
#then iterate through each face of the copy, extract it using rg.Mesh.ExtractFaces
#and store the result into a list called exploded in output d

exploded=[]
numesh=m.Duplicate()
nufaces=numesh.Faces
for k in range(len(nufaces)):
     explo=nufaces.ExtractFaces([0])
     exploded.append(explo)

d = exploded

#after here, your task is to apply a transformation to each face of the mesh
#the transformation should correspond to the angle value that corresponds that face to it... 
#the result should be a mesh that responds to the sun position... its up to you!

circles=[]
d_outlines=[]
moved_circles=[]
# offsetcurve=[]
# extrusion=[]
NL=[]
for k in range(len(d)):
    pl=rg.Plane(b[k], a[k])
    # out=rg.Mesh.GetOutlines(d[k], pl)[0]
    out=rg.Mesh.GetNakedEdges(d[k])
    for l in range(len(out)):
        m_line=out[l]
        linesss=m_line.ToNurbsCurve()
        NL.append(linesss)
    NB=rg.Curve.JoinCurves(NL)[0]
    d_outlines.append(NB)
    circ=rg.Circle(pl, 0.05*c[k])
    circ_nurb=rg.Circle.ToNurbsCurve(circ, 2, 5)
    rg.Curve.Transform(circ_nurb, rg.Transform.Translation(a[k]))
    circles.append(circ)
    moved_circles.append(circ_nurb)

circ=circles
joined_outlines=d_outlines

#remap angleList
remapped=[]
for i in angleList:
    remapped_value=(((i - min(angleList)) * (max_off - min_off)) / (max(angleList) - min(angleList))) + min_off
    remapped.append(remapped_value)

#Get the Faces outlines
outlines = []
for i in exploded:
    outline = rg.Mesh.GetNakedEdges(i)
    outlines.append(outline)

# outlines=th.list_to_tree(outlines)

#join outlines
joined_outlines=[]
for i in outlines:
    curves=[]
    for j in i:
        curve=rg.Polyline.ToNurbsCurve(j)
        curves.append(curve)
    joined=rg.Curve.JoinCurves(curves)[0]
    joined_outlines.append(joined)

#Offset outlines
#get 4 points off the mesh and draw surface from them
mesh_points=[]
for i in exploded:
    points=rg.Mesh.Vertices.GetValue(i) #this line and i.Vertices is the same thing
    # points=i.Vertices
    mesh_points.append(points)
mesh_points_3d=[]
for i in mesh_points:
    sub=[]
    for j in i:
        pt=rg.Point3d(j)
        sub.append(pt)
    mesh_points_3d.append(sub)
    
#mesh_points_3d=th.list_to_tree(mesh_points_3d)

#Create Nurbs Surface
surfaces=[]
offset_outlines=[]
for i in range(len(joined_outlines)):
    surface=rg.NurbsSurface.CreateFromPoints(mesh_points_3d[i],2,2,2,2)
    off=rg.Curve.OffsetOnSurface(joined_outlines[i],surface,remapped[i],.001)[0]
    offset_outlines.append(off)
    surfaces.append(surface)


#Loft
lofted_breps=[]
for i in range(len(offset_outlines)):
     list_curves=[offset_outlines[i],joined_outlines[i]]
     lofted=rg.Brep.CreateFromLoft(list_curves, rg.Point3d.Unset, rg.Point3d.Unset, rg.LoftType.Normal, False)[0]
     lofted_breps.append(lofted)

#Loft circle and inner frame
lofted_cones=[]
for i in range(len(offset_outlines)):
    t_p=rg.Curve.ClosestPoint(moved_circles[i],rg.Curve.PointAt(offset_outlines[i],0),5)[1]
    rg.Curve.ChangeClosedCurveSeam(moved_circles[i],t_p)
    list_curves2=[offset_outlines[i], moved_circles[i]]
    lofted_circs=rg.Brep.CreateFromLoft(list_curves2, rg.Point3d.Unset, rg.Point3d.Unset, rg.LoftType.Normal, False)[0]
    lofted_cones.append(lofted_circs)



########################################## BONUS EXERCISE
#get vertex normals
mesh_copy=m.Duplicate()
Vertex_normal_list=rg.Mesh.Normals.GetValue(mesh_copy) #this gives mesh vertices normals
# rgc.MeshVertexNormalList.ComputeNormals(Vertex_normal_list)
e=Vertex_normal_list
vert=mesh_copy.Vertices

#Move vertices 
#moved_vertex=[]
#for i in range(len(Vertex_normal_list)):
#    pt=rg.Point3d(vert[i])
#    vector=rg.Vector3d.Multiply((vec_length/abs(Vertex_normal_list[i].Length)), Vertex_normal_list[i])
#    rg.Point3d.Transform(pt, rg.Transform.Translation(vector))
#    moved_vertex.append(pt)

# Sort points
list_1=[]
for i in range(0, len(vert), V+1):
    sub_list=[]
    for j in range(V+1):
        pt=rg.Point3d(vert[i+j])
        sub_list.append(pt)
        # pt=vert[i][j]
    # sub_list.append(pt)
    list_1.append(sub_list)
# moved_vertex=th.list_to_tree(list_1)
list_11=th.list_to_tree(list_1)

list_2=[]
#sort in other direction
for i in range(0,V+1):
    sub=[]
    for j in range(U+1):
        pt=rg.Point3d(vert[i+j+(j*V)])
        sub.append(pt)
    list_2.append(sub)
    

list_22=th.list_to_tree(list_2)

######
# Draw Polylines
polylines_1=[]
for i in list_1:
    poly=rg.Polyline(i)
    polylines_1.append(poly)
polylines_2=[]
for i in list_2:
    poly=rg.Polyline(i)
    polylines_2.append(poly)
    
T_Parameters_1=[]
for i in range(len(list_1)):
    sub=[]
    for j in range(len(list_1[i])):
        
        curve=rg.Polyline.ToNurbsCurve(polylines_1[i])
        t_p=rg.Curve.ClosestPoint(curve, list_1[i][j],.1)[1]
        sub.append(t_p)
    T_Parameters_1.append(sub)

T_Parameters_2=[]
for i in range(len(list_2)):
    sub=[]
    for j in range(len(list_2[i])):
        
        curve=rg.Polyline.ToNurbsCurve(polylines_2[i])
        t_p=rg.Curve.ClosestPoint(curve, list_2[i][j],.1)[1]
        sub.append(t_p)
    T_Parameters_2.append(sub)


##########

tangents_1=[]
points_1=[]
for i in range(len(polylines_1)):
    sub=[]
    sub_pt=[]
    for j in range(V+1):
        curve=rg.Polyline.ToNurbsCurve(polylines_1[i])
        pt=rg.Curve.PointAt(curve,T_Parameters_1[i][j])
        tan=rg.NurbsCurve.TangentAt(curve,T_Parameters_1[i][j])
        sub.append(tan)
        sub_pt.append(pt)
    points_1.append(sub_pt)
    tangents_1.append(sub)
#points_1=th.list_to_tree(points_1)

tangents_2=[]
points_2=[]
for i in range(len(polylines_2)):
    sub=[]
    sub_pt=[]
    for j in range(U+1):
        curve=rg.Polyline.ToNurbsCurve(polylines_2[i])
        pt=rg.Curve.PointAt(curve,T_Parameters_2[i][j])
        tan=rg.NurbsCurve.TangentAt(curve,T_Parameters_2[i][j])
        sub.append(tan)
        sub_pt.append(pt)
    points_2.append(sub_pt)
    tangents_2.append(sub)
#points_2=th.list_to_tree(points_2)


#Graft_normal_list_2
Grafted_normals_2=[]
for i in range(V+1):
    sub=[]
    for j in range(U+1):
        grafted=Vertex_normal_list[i+(j*V)+j]
#        grafted=rg.Vector3d(grafted)
        sub.append(grafted)
    Grafted_normals_2.append(sub)
cc=th.list_to_tree(Grafted_normals_2)


#############
#Graft_normal_list_1
Grafted_normals_1=[]
for i in range(0,len(vert),V+1):
    sub_list=[]
    for j in range(V+1):
        grafted=Vertex_normal_list[i+j]
        grafted=rg.Vector3d(grafted) #to avoid the problem of vector3f
        sub_list.append(grafted)
    Grafted_normals_1.append(sub_list)
dd=th.list_to_tree(Grafted_normals_1)

#get the cross product OF THE VECTORS

cross_vector_1=[]
cross_vector_2=[]
for i in range(len(Grafted_normals_1)):
    sub_1=[]
    for j in range(len(Grafted_normals_1[i])):
        cross_v_1=rg.Vector3d.CrossProduct(Grafted_normals_1[i][j],tangents_1[i][j])
        sub_1.append(cross_v_1)
    cross_vector_1.append(sub_1)
        
for i in range(len(Grafted_normals_2)):
    sub_2=[]
    for j in range(len(Grafted_normals_2[i])):
        cross_v_2=rg.Vector3d.CrossProduct(Grafted_normals_2[i][j],tangents_2[i][j])
        sub_2.append(cross_v_2)
    cross_vector_2.append(sub_2)
vectors_1=th.list_to_tree(cross_vector_1)
vectors_2=th.list_to_tree(cross_vector_2)

####### GET PLANES

planes_1=[]
for i in range(len(Grafted_normals_1)):
    sub=[]
    for j in range(len(Grafted_normals_1[i])):
        plane_1=rg.Plane(points_1[i][j], Grafted_normals_1[i][j],cross_vector_1[i][j])
        sub.append(plane_1)
    planes_1.append(sub)
    
planes_2=[]
for i in range(len(Grafted_normals_2)):
    sub=[]
    for j in range(len(Grafted_normals_2[i])):
        plane_2=rg.Plane(points_2[i][j], Grafted_normals_2[i][j],cross_vector_2[i][j])
        sub.append(plane_2)
    planes_2.append(sub)
#planes_1=th.list_to_tree(planes_1)
#planes_2=th.list_to_tree(planes_2)

#Draw rectangles
rectangles_1=[]
for i in range(len(planes_1)):
    sub=[]
    for j in range(len(planes_1[i])):
        rec=rg.Rectangle3d(planes_1[i][j], height, width)
        sub.append(rec)
    rectangles_1.append(sub)

rectangles_2=[]
for i in range(len(planes_2)):
    sub=[]
    for j in range(len(planes_2[i])):
        rec=rg.Rectangle3d(planes_2[i][j], height, width)
        sub.append(rec)
    rectangles_2.append(sub)

#rectangles_1=th.list_to_tree(rectangles_1)
#rectangles_2=th.list_to_tree(rectangles_2)

#MOVE THE RECTANGLES

cross_sections_1=[]
for i in range(len(rectangles_1)):
    sub=[]
    for j in range(len(rectangles_1[i])):
        vect1=rg.Vector3d.Multiply((-height/2)/abs(Grafted_normals_1[i][j].Length), Grafted_normals_1[i][j])
        vect2=rg.Vector3d.Multiply((-width/2)/abs(cross_vector_1[i][j].Length), cross_vector_1[i][j])
        rg.Rectangle3d.Transform(rectangles_1[i][j], rg.Transform.Translation(vect1))
        rg.Rectangle3d.Transform(rectangles_1[i][j],rg.Transform.Translation(vect2))
        rec=rg.Rectangle3d.ToNurbsCurve(rectangles_1[i][j])
        sub.append(rec)
    cross_sections_1.append(sub)

cross_sections_2=[]
for i in range(len(rectangles_2)):
    sub=[]
    for j in range(len(rectangles_2[i])):
        vect1=rg.Vector3d.Multiply((-height/2)/abs(Grafted_normals_2[i][j].Length), Grafted_normals_2[i][j])
        vect2=rg.Vector3d.Multiply((-width/2)/abs(cross_vector_2[i][j].Length), cross_vector_2[i][j])
        rg.Rectangle3d.Transform(rectangles_2[i][j], rg.Transform.Translation(vect1))
        rg.Rectangle3d.Transform(rectangles_2[i][j],rg.Transform.Translation(vect2))
        rec=rg.Rectangle3d.ToNurbsCurve(rectangles_2[i][j])
        sub.append(rec)
    cross_sections_2.append(sub)

#cross_sections_2=th.list_to_tree(cross_sections_2)
#cross_sections_1=th.list_to_tree(cross_sections_1)

#Loft
beams_1=[]
for i in cross_sections_1:
    beam=rg.Brep.CreateFromLoft(i, rg.Point3d.Unset, rg.Point3d.Unset, rg.LoftType.Normal, False)[0]
    beams_1.append(beam)

beams_2=[]
for i in cross_sections_2:
    beam=rg.Brep.CreateFromLoft(i, rg.Point3d.Unset, rg.Point3d.Unset, rg.LoftType.Normal, False)[0]
    beams_2.append(beam)
# ---------- end python_3 ----------
data_2 = Data(python_3.joined_outlines)
data_3 = Data(python_3.offset_outlines)
data_4 = Data(python_3.polylines_1)
data_5 = Data(python_3.polylines_2)
vdis_2 = VectorDisplay(Anchor=python_3.b, Vector=python_3.a)
list_item = ListItem(List=data_2, Index=Slider(0, range=0..400), Wrap=True)
curve = Curve(list_item)
bnd = Bounds(Numbers=python_3.c)

# ---- group: Mesh Vertex Normals
# Geometry Outcome
vector_display = VectorDisplay(Anchor=python_3.vert, Vector=python_3.e)

# ---- group: Lofted Cones
data_6 = Data(python_3.lofted_cones)

# ---- group: Lofted Base
data_7 = Data(python_3.lofted_breps)

# ----
# BONUS: BUILD A FRAME
data_8 = Data(python_3.beams_1)
data_9 = Data(python_3.beams_2)

dedomain = DeconstructDomain(Domain=bnd)  # -> Start, End
gradient = Gradient(
    LowerLimit=dedomain.Start,
    UpperLimit=dedomain.End,
    Parameter=python_3.c,
    stops=[0: RGB(234, 38, 0), 0.25: RGB(234, 126, 0), 0.5: RGB(254, 244, 84), 0.75: RGB(173, 203, 249), 1: RGB(75, 107, 169)])
merge = Merge(Data1=flatten(data_7), Data2=data_6, Data3=python_3.d)
bnd_2 = Bounds(Numbers=python_3.c)
dedomain_2 = DeconstructDomain(Domain=bnd_2)  # -> Start, End
preview = CustomPreview(Geometry=merge, Material=gradient)
gradient_2 = Gradient(
    LowerLimit=dedomain_2.Start,
    UpperLimit=dedomain_2.End,
    Parameter=python_3.c,
    stops=[0: RGB(0, 98, 0), 0.25: RGB(81, 175, 17), 0.5: RGB(159, 198, 146), 0.75: RGB(170, 235, 41), 1: RGB(221, 255, 53)])
merge_2 = Merge(Data1=data_8, Data2=data_9)
preview_2 = CustomPreview(Geometry=merge_2, Material=gradient_2)

# ----
# BONUS MESH
number_slider_4 = Slider(50, range=0..10000)
mesh_2 = Mesh(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)
unit_y = UnitY(Factor=number_slider_4)
wbcatmullclark = WeaverbirdsCatmullClarkSubdivision(MeshCurves=mesh_2, Level=1, SmoothNakedEdges=1)
move = Move(Geometry=wbcatmullclark, Motion=unit_y)  # -> Geometry, Transform
quad_remesh_settings = QuadRemeshSettings(
    TargetCount=Slider(500, range=0..1000),
    AdaptiveSize=0,
    AdaptiveCount=False,
    HardEdges=False,
    SeamEdges=0,
    Symmetry=0,
    GuideCurves=0)
path_2 = FilePath("G:\My Drive\AIA Geo Opt\A02\a02_SM bonus.py")
quad_remesh = QuadRemesh(Mesh=move.Geometry, Settings=quad_remesh_settings)
file_2 = ReadFile(File=path_2, PerLineParse=False)
python_4 = GhPythonScript(
    m=quad_remesh,
    s=python_2.c,
    vec_length=number_slider_3,
    U=Slider(24, range=0..100),
    V=Slider(24, range=0..100),
    min_off=Slider(0.08, range=0..0.5),
    max_off=Slider(0.33, range=0..1))  # -> out, a, b, c, d, joined_outlines, outlines, mesh_points_3d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; inputs m: Mesh, s: Vector3d, U: Int32, V: Int32
# ---------- python_4: Python ----------
"""Provides a scripting component.
    Inputs:
        m: a mesh
        s: sun vector
    Output:
        a: List of Vectors
        b: List of Points
        c: list of angles
        d: exploded mesh
        """

#mesh needed to be flipped for correct vector direction

m.Flip(m,True,True)

import Rhino.Geometry as rg
import ghpythonlib.treehelpers as th
import math
import rhinoscriptsyntax as rs
import Rhino.Geometry.Collections as rgc


#1.
#compute face normals using rg.Mesh.FaceNormals.ComputeFaceNormals()
#output the vectors to a

m.FaceNormals.ComputeFaceNormals()

a = m.FaceNormals

#2.
#get the centers of each faces using rg.Mesh.Faces.GetFaceCenter()
#store the centers into a list called centers 
#output that list to b

centers = []
for i in range(len(m.Faces)):
    center = m.Faces.GetFaceCenter(i)
    centers.append(center)

b = centers

#3.
#calculate the angle between the sun and each FaceNormal using rg.Vector3d.VectorAngle()
#store the angles in a list called angleList and output it to c

angleList=[]
for j in a:
    angle = rg.Vector3d.VectorAngle(j, s)
    angleList.append(angle)

c = angleList

#4. explode the mesh - convert each face of the mesh into a mesh
#for this, you have to first copy the mesh using rg.Mesh.Duplicate()
#then iterate through each face of the copy, extract it using rg.Mesh.ExtractFaces
#and store the result into a list called exploded in output d

exploded=[]
numesh=m.Duplicate()
nufaces=numesh.Faces
for k in range(len(nufaces)):
     explo=nufaces.ExtractFaces([0])
     exploded.append(explo)

d = exploded

#after here, your task is to apply a transformation to each face of the mesh
#the transformation should correspond to the angle value that corresponds that face to it... 
#the result should be a mesh that responds to the sun position... its up to you!

#remap angleList
remapped=[]
for i in angleList:
    remapped_value=(((i - min(angleList)) * (max_off - min_off)) / (max(angleList) - min(angleList))) + min_off
    remapped.append(remapped_value)

#Get the Faces outlines
outlines = []
for i in exploded:
    outline = rg.Mesh.GetNakedEdges(i)
    outlines.append(outline)

#outlines=th.list_to_tree(outlines)

#join outlines
joined_outlines=[]
for i in outlines:
    curves=[]
    for j in i:
        curve=rg.Polyline.ToNurbsCurve(j)
        curves.append(curve)
    joined=rg.Curve.JoinCurves(curves)[0]
    joined_outlines.append(joined)

#Offset outlines
#get 4 points off the mesh and draw surface from them
mesh_points=[]
for i in exploded:
    points=rg.Mesh.Vertices.GetValue(i) #this line and i.Vertices is the same thing
    # points=i.Vertices
    mesh_points.append(points)
mesh_points_3d=[]
for i in mesh_points:
    sub=[]
    for j in i:
        pt=rg.Point3d(j)
        sub.append(pt)
    mesh_points_3d.append(sub)
    
#mesh_points_3d=th.list_to_tree(mesh_points_3d)



########THIS PART DID NOT WORK############
#Create Nurbs Surface
# surfaces=[]
# offset_outlines=[]
# for i in range(48):
#     surface=rg.NurbsSurface.CreateFromPoints(mesh_points_3d[i],2,2,2,2)
#     off=rg.Curve.OffsetOnSurface(joined_outlines[i],surface,remapped[i],.001)
#     offset_outlines.append(off)
#     surfaces.append(surface)

# offset_outlines=th.list_to_tree(offset_outlines)
##########################################



circles=[]
moved_circles=[]
for k in range(len(d)):
     pl=rg.Plane(b[k], a[k])
     circ=rg.Circle(pl, 0.1*c[k])
     circ_nurb=rg.Circle.ToNurbsCurve(circ, 2, 5)
     rg.Curve.Transform(circ_nurb, rg.Transform.Translation(a[k]))
     circles.append(circ)
     moved_circles.append(circ_nurb)



# #Loft
# lofted_breps=[]
# for i in range(len(offset_outlines)):
#      list_curves=[offset_outlines[i],joined_outlines[i]]
#      lofted=rg.Brep.CreateFromLoft(list_curves, rg.Point3d.Unset, rg.Point3d.Unset, rg.LoftType.Normal, False)[0]
#      lofted_breps.append(lofted)

#Loft circle and inner frame
lofted_cones=[]
for i in range(len(joined_outlines)):
    t_p=rg.Curve.ClosestPoint(moved_circles[i],rg.Curve.PointAt(joined_outlines[i],0),5)[1]
    rg.Curve.ChangeClosedCurveSeam(moved_circles[i],t_p)
    list_curves2=[joined_outlines[i], moved_circles[i]]
    lofted_circs=rg.Brep.CreateFromLoft(list_curves2, rg.Point3d.Unset, rg.Point3d.Unset, rg.LoftType.Normal, False)[0]
    lofted_cones.append(lofted_circs)



########################################## BONUS EXERCISE
#get vertex normals
mesh_copy=m.Duplicate()
Vertex_normal_list=rg.Mesh.Normals.GetValue(mesh_copy) #this gives mesh vertices normals
# rgc.MeshVertexNormalList.ComputeNormals(Vertex_normal_list)
e=Vertex_normal_list
vert=mesh_copy.Vertices



#####################ONLY DID UP TILL THIS POINT################




"""
#Move vertices 
#moved_vertex=[]
#for i in range(len(Vertex_normal_list)):
#    pt=rg.Point3d(vert[i])
#    vector=rg.Vector3d.Multiply((vec_length/abs(Vertex_normal_list[i].Length)), Vertex_normal_list[i])
#    rg.Point3d.Transform(pt, rg.Transform.Translation(vector))
#    moved_vertex.append(pt)

# Sort points
list_1=[]
for i in range(0, len(vert), V+1):
    sub_list=[]

    for j in range(V+1):
        pt=rg.Point3d(vert[i+j])

        sub_list.append(pt)
        # pt=vert[i][j]
    # sub_list.append(pt)
    list_1.append(sub_list)
# moved_vertex=th.list_to_tree(list_1)
list_11=th.list_to_tree(list_1)

list_2=[]
#sort in other direction
for i in range(0,V+1):
    sub=[]
    for j in range(U+1):
        pt=rg.Point3d(vert[i+j+(j*V)])
        sub.append(pt)
    list_2.append(sub)
    

list_22=th.list_to_tree(list_2)

######
# Draw Polylines
polylines_1=[]
for i in list_1:
    poly=rg.Polyline(i)
    polylines_1.append(poly)
polylines_2=[]
for i in list_2:
    poly=rg.Polyline(i)
    polylines_2.append(poly)
    
T_Parameters_1=[]
for i in range(len(list_1)):
    sub=[]
    for j in range(len(list_1[i])):
        
        curve=rg.Polyline.ToNurbsCurve(polylines_1[i])
        t_p=rg.Curve.ClosestPoint(curve, list_1[i][j],.1)[1]
        sub.append(t_p)
    T_Parameters_1.append(sub)

T_Parameters_2=[]
for i in range(len(list_2)):
    sub=[]
    for j in range(len(list_2[i])):
        
        curve=rg.Polyline.ToNurbsCurve(polylines_2[i])
        t_p=rg.Curve.ClosestPoint(curve, list_2[i][j],.1)[1]
        sub.append(t_p)
    T_Parameters_2.append(sub)


##########

tangents_1=[]
points_1=[]
for i in range(len(polylines_1)):
    sub=[]
    sub_pt=[]
    for j in range(V+1):
        curve=rg.Polyline.ToNurbsCurve(polylines_1[i])
        pt=rg.Curve.PointAt(curve,T_Parameters_1[i][j])
        tan=rg.NurbsCurve.TangentAt(curve,T_Parameters_1[i][j])
        sub.append(tan)
        sub_pt.append(pt)
    points_1.append(sub_pt)
    tangents_1.append(sub)
#points_1=th.list_to_tree(points_1)

tangents_2=[]
points_2=[]
for i in range(len(polylines_2)):
    sub=[]
    sub_pt=[]
    for j in range(U+1):
        curve=rg.Polyline.ToNurbsCurve(polylines_2[i])
        pt=rg.Curve.PointAt(curve,T_Parameters_2[i][j])
        tan=rg.NurbsCurve.TangentAt(curve,T_Parameters_2[i][j])
        sub.append(tan)
        sub_pt.append(pt)
    points_2.append(sub_pt)
    tangents_2.append(sub)
#points_2=th.list_to_tree(points_2)


#Graft_normal_list_2
Grafted_normals_2=[]
for i in range(V+1):
    sub=[]
    for j in range(U+1):
        grafted=Vertex_normal_list[i+(j*V)+j]
#        grafted=rg.Vector3d(grafted)
        sub.append(grafted)
    Grafted_normals_2.append(sub)
cc=th.list_to_tree(Grafted_normals_2)


#############
#Graft_normal_list_1
Grafted_normals_1=[]
for i in range(0,len(vert),V+1):
    sub_list=[]
    for j in range(V+1):
        grafted=Vertex_normal_list[i+j]
        grafted=rg.Vector3d(grafted) #to avoid the problem of vector3f
        sub_list.append(grafted)
    Grafted_normals_1.append(sub_list)
dd=th.list_to_tree(Grafted_normals_1)

#get the cross product OF THE VECTORS

cross_vector_1=[]
cross_vector_2=[]
for i in range(len(Grafted_normals_1)):
    sub_1=[]
    for j in range(len(Grafted_normals_1[i])):
        cross_v_1=rg.Vector3d.CrossProduct(Grafted_normals_1[i][j],tangents_1[i][j])
        sub_1.append(cross_v_1)
    cross_vector_1.append(sub_1)
        
for i in range(len(Grafted_normals_2)):
    sub_2=[]
    for j in range(len(Grafted_normals_2[i])):
        cross_v_2=rg.Vector3d.CrossProduct(Grafted_normals_2[i][j],tangents_2[i][j])
        sub_2.append(cross_v_2)
    cross_vector_2.append(sub_2)
vectors_1=th.list_to_tree(cross_vector_1)
vectors_2=th.list_to_tree(cross_vector_2)

####### GET PLANES

planes_1=[]
for i in range(len(Grafted_normals_1)):
    sub=[]
    for j in range(len(Grafted_normals_1[i])):
        plane_1=rg.Plane(points_1[i][j], Grafted_normals_1[i][j],cross_vector_1[i][j])
        sub.append(plane_1)
    planes_1.append(sub)
    
planes_2=[]
for i in range(len(Grafted_normals_2)):
    sub=[]
    for j in range(len(Grafted_normals_2[i])):
        plane_2=rg.Plane(points_2[i][j], Grafted_normals_2[i][j],cross_vector_2[i][j])
        sub.append(plane_2)
    planes_2.append(sub)
#planes_1=th.list_to_tree(planes_1)
#planes_2=th.list_to_tree(planes_2)

#Draw rectangles
rectangles_1=[]
for i in range(len(planes_1)):
    sub=[]
    for j in range(len(planes_1[i])):
        rec=rg.Rectangle3d(planes_1[i][j], height, width)
        sub.append(rec)
    rectangles_1.append(sub)

rectangles_2=[]
for i in range(len(planes_2)):
    sub=[]
    for j in range(len(planes_2[i])):
        rec=rg.Rectangle3d(planes_2[i][j], height, width)
        sub.append(rec)
    rectangles_2.append(sub)

#rectangles_1=th.list_to_tree(rectangles_1)
#rectangles_2=th.list_to_tree(rectangles_2)

#MOVE THE RECTANGLES

cross_sections_1=[]
for i in range(len(rectangles_1)):
    sub=[]
    for j in range(len(rectangles_1[i])):
        vect1=rg.Vector3d.Multiply((-height/2)/abs(Grafted_normals_1[i][j].Length), Grafted_normals_1[i][j])
        vect2=rg.Vector3d.Multiply((-width/2)/abs(cross_vector_1[i][j].Length), cross_vector_1[i][j])
        rg.Rectangle3d.Transform(rectangles_1[i][j], rg.Transform.Translation(vect1))
        rg.Rectangle3d.Transform(rectangles_1[i][j],rg.Transform.Translation(vect2))
        rec=rg.Rectangle3d.ToNurbsCurve(rectangles_1[i][j])
        sub.append(rec)
    cross_sections_1.append(sub)

cross_sections_2=[]
for i in range(len(rectangles_2)):
    sub=[]
    for j in range(len(rectangles_2[i])):
        vect1=rg.Vector3d.Multiply((-height/2)/abs(Grafted_normals_2[i][j].Length), Grafted_normals_2[i][j])
        vect2=rg.Vector3d.Multiply((-width/2)/abs(cross_vector_2[i][j].Length), cross_vector_2[i][j])
        rg.Rectangle3d.Transform(rectangles_2[i][j], rg.Transform.Translation(vect1))
        rg.Rectangle3d.Transform(rectangles_2[i][j],rg.Transform.Translation(vect2))
        rec=rg.Rectangle3d.ToNurbsCurve(rectangles_2[i][j])
        sub.append(rec)
    cross_sections_2.append(sub)

#cross_sections_2=th.list_to_tree(cross_sections_2)
#cross_sections_1=th.list_to_tree(cross_sections_1)

#Loft
beams_1=[]
for i in cross_sections_1:
    beam=rg.Brep.CreateFromLoft(i, rg.Point3d.Unset, rg.Point3d.Unset, rg.LoftType.Normal, False)[0]
    beams_1.append(beam)

beams_2=[]
for i in cross_sections_2:
    beam=rg.Brep.CreateFromLoft(i, rg.Point3d.Unset, rg.Point3d.Unset, rg.LoftType.Normal, False)[0]
    beams_2.append(beam)

"""
# ---------- end python_4 ----------
data_10 = Data(python_4.offset_outlines)
data_11 = Data(python_4.circles)
data_12 = Data(python_4.moved_circles)
data_13 = Data(python_4.mesh_points_3d)
data_14 = Data(python_4.joined_outlines)
data_15 = Data(python_4.outlines)
vdis_3 = VectorDisplay(Anchor=python_4.b, Vector=python_4.a)
bnd_3 = Bounds(Numbers=python_4.c)
dedomain_3 = DeconstructDomain(Domain=bnd_3)  # -> Start, End
gradient_3 = Gradient(
    LowerLimit=dedomain_3.Start,
    UpperLimit=dedomain_3.End,
    Parameter=python_4.c,
    stops=[0: RGB(234, 38, 0), 0.25: RGB(234, 126, 0), 0.5: RGB(254, 244, 84), 0.75: RGB(173, 203, 249), 1: RGB(75, 107, 169)])

# ---- group: Lofted Cones
data_16 = Data(python_4.lofted_cones)

# ---- group: Mesh Vertex Normals
# Bonus Mesh: Geometry Outcome
vdis_4 = VectorDisplay(Anchor=python_4.vert, Vector=python_4.e)

# ----
merge_3 = Merge(Data1=python_4.d, Data2=flatten(data_16))
preview_3 = CustomPreview(Geometry=merge_3, Material=gradient_3)
